# Grasshopper definition mean value coordinate.gh (Grasshopper 1.0.7)

crv = Curve(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)
explode = Explode(Curve=crv, Recursive=True)  # -> Segments, Vertices
line = Line(explode.Segments)
rev = ReverseList(List=line)
series = Series(Start=0, Step=1, Count=6)
item = ListItem(List=rev, Index=series, Wrap=True)  # -> Item1, Item

# ---- group: V_0
pt = Point(Point(-4.948278454, 4.212414616, 0))

# ----
end = EndPoints(Curve=item.Item)  # -> Start, End

# ---- group: v_i
v = Point(end.End)

# ----
xy = XYPlane(Origin=Point(0, 0, 0))

end_2 = EndPoints(Curve=item.Item)  # -> Start, End
vec2pt = Vector2Pt(PointA=pt, PointB=end_2.Start, Unitize=False)  # -> Vector, Length
vec2pt_2 = Vector2Pt(PointA=pt, PointB=end_2.End, Unitize=False)  # -> Vector, Length
angle = Angle(VectorA=vec2pt.Vector, VectorB=vec2pt_2.Vector, Plane=xy)  # -> Angle, Reflex

# ---- group: w_i / alpha_i-1 & alpha_i
cluster = Cluster_2(C=item.Item1, A=pt)  # -> V, A_2
cluster_2 = Cluster_2(C=item.Item, A=pt)  # -> V, A_2

# ---- group: w_i
division = Division(A=cluster.A_2, B=2)
division_2 = Division(A=cluster_2.A_2, B=2)
subtraction = Subtraction(A=v, B=pt)
tan = Tangent(Value=division_2)
tan_2 = Tangent(Value=division)
vlen = VectorLength(Vector=subtraction)
addition = Addition(A=tan_2, B=tan)
division_3 = Division(A=addition, B=vlen)

# ----
cluster_3 = Cluster_2(C=item.Item, A=pt)  # -> V, A_2
deg = Degrees(Radians=cluster_3.A_2)
round = Round(Number=deg)  # -> Nearest, Floor, Ceiling
cluster_4 = Cluster(V=cluster_3.V, x=deg, G=pt)
vdis = VectorDisplay(Anchor=pt, Vector=cluster_3.V)
tag = TextTag(Location=cluster_4, Text=round.Nearest, Colour=ColourSwatch(SwatchColor=RGB(255, 255, 255)))

ma = MassAddition(Input=division_3)  # -> Result, PartialResults
division_4 = Division(A=division_3, B=ma.Result)
multiplication = Multiplication(A=division_4, B=v)
ma_2 = MassAddition(Input=division_4)  # -> Result, PartialResults
ma_3 = MassAddition(Input=multiplication)  # -> Result, PartialResults
panel = Panel(pt)
panel_2 = Panel(ma_3.Result)

# ==== cluster Cluster
x = ClusterInput()
neg = Negative(Value=x)
division = Division(A=neg, B=2)
rad = Radians(Degrees=division)
Z = UnitZ(Factor=1)
V = ClusterInput()
G = ClusterInput()
vrot = Rotate(Vector=V, Axis=Z, Angle=rad)
unit = UnitVector(Vector=vrot)
multiplication = Multiplication(A=unit, B=Slider(1, range=0..10))
move = Move(Geometry=G, Motion=multiplication)  # -> Geometry, Transform
G_2 = ClusterOutput(move.Geometry)

# ==== cluster Cluster_2
C = ClusterInput()
A = ClusterInput()

end = EndPoints(Curve=C)  # -> Start, End
vec2pt = Vector2Pt(PointA=A, PointB=end.Start, Unitize=False)  # -> Vector, Length
vec2pt_2 = Vector2Pt(PointA=A, PointB=end.End, Unitize=False)  # -> Vector, Length
angle = Angle(VectorA=vec2pt.Vector, VectorB=vec2pt_2.Vector)  # -> Angle, Reflex

V = ClusterOutput(vec2pt.Vector)
A_2 = ClusterOutput(angle.Angle)
