# Grasshopper definition transfinite.gh (Grasshopper 1.0.7)
# plug-ins: Transfinite

number_slider = Slider(50, range=0..100)
u_scale = U_scale(40)
number_slider_2 = Slider(100, range=0..100)
number_slider_3 = Slider(100, range=0..100)
number_slider_4 = Slider(500, range=0..1000)
nickname = Transfinite(U=Slider(0.2, range=0..1), V=0, U_scale=number_slider_3, V_scale=number_slider_3, N=3)  # -> Curves, DomainPolygon, Landa, Kappa, Nu, Kato, Kato_pointlist, Patches, PlnError, Maplist
pt = Point(nickname.Kato_pointlist)
pt_2 = Point(nickname.Kato)
c_script = CSharpScript(x=pt_2, y=pt)  # -> out, A; inputs x: list of Point3d, y: list of Point3d
# ---------- c_script: C# ----------
    if(x.Count == 0 || y.Count == 0) return;
    
    List<List<Point3d>> pointlist = new List<List<Point3d>>();
    Point3d prewpt = new Point3d();
    for (int i = 0; i < x.Count; i++)
    {

      if(i == 0 || !((x[i].Y - prewpt.Y) < 0.0001))
      {
        pointlist.Add(new List<Point3d>());
        pointlist[pointlist.Count - 1].Add(y[i]);
      }
      else if((x[i].Y - prewpt.Y) < 0.0001)
      {
        pointlist[pointlist.Count - 1].Add(y[i]);
      }

      prewpt = x[i];
    }

    List<Curve> outcrv = new List<Curve>();
    for (int i = 0; i < pointlist.Count; i++)
    {
      outcrv.Add(Curve.CreateControlPointCurve(pointlist[i], 3));
    }

    A = outcrv;
# ---------- end c_script ----------
c_script_2 = CSharpScript(x=pt_2, y=pt)  # -> out, A, B; inputs x: list of Point3d, y: list of Point3d
# ---------- c_script_2: C# ----------
    if(x.Count == 0 || y.Count == 0) return;

    List<List<Point3d>> pointlist = new List<List<Point3d>>();
    Point3d prewpt = new Point3d();
    for (int i = 0; i < x.Count; i++)
    {

      if(i == 0 || !((x[i].Y - prewpt.Y) < 0.0001))
      {
        pointlist.Add(new List<Point3d>());
        pointlist[pointlist.Count - 1].Add(y[i]);
      }
      else if((x[i].Y - prewpt.Y) < 0.0001)
      {
        pointlist[pointlist.Count - 1].Add(y[i]);
      }

      prewpt = x[i];
    }

    //*****
    List<Curve> outcrv2 = new List<Curve>();
    int j = 0,outt = 0;
    while(true)
    {
      List<Point3d> ptlist = new List<Point3d>();
      for (int i = 0; i < pointlist.Count; i++)
      {
        if(j > pointlist[i].Count - 1)
        {
          outt++;
          continue;
        }
        else
        {
          ptlist.Add(pointlist[i][j]);
        }
      }
      if(ptlist.Count == 0) break;
      outcrv2.Add(Curve.CreateControlPointCurve(ptlist, 1));
      j++;
    }
    B = outcrv2;
    //*******

    List<Curve> outcrv = new List<Curve>();
    for (int i = 0; i < pointlist.Count; i++)
    {
      outcrv.Add(Curve.CreateControlPointCurve(pointlist[i], 1));
    }

    A = outcrv;
    ///******
# ---------- end c_script_2 ----------
item = ListItem(List=c_script.A, Index=0, Wrap=True)  # -> Item, Item1, Item2, Item3, Item4, Item5, Item6, Item7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
rulesrf = RuledSurface(CurveA=item.Item5, CurveB=item.Item6)
rulesrf_2 = RuledSurface(CurveA=item.Item8, CurveB=item.Item9)
rulesrf_3 = RuledSurface(CurveA=item.Item4, CurveB=item.Item5)
rulesrf_4 = RuledSurface(CurveA=item.Item7, CurveB=item.Item8)
rulesrf_5 = RuledSurface(CurveA=item.Item3, CurveB=item.Item4)
rulesrf_6 = RuledSurface(CurveA=item.Item6, CurveB=item.Item7)
rulesrf_7 = RuledSurface(CurveA=item.Item2, CurveB=item.Item3)
rulesrf_8 = RuledSurface(CurveA=item.Item9, CurveB=item.Item10)
rulesrf_9 = RuledSurface(CurveA=item.Item1, CurveB=item.Item2)
rulesrf_10 = RuledSurface(CurveA=item.Item, CurveB=item.Item1)
rulesrf_11 = RuledSurface(CurveA=item.Item10, CurveB=item.Item11)
rulesrf_12 = RuledSurface(CurveA=item.Item13, CurveB=item.Item14)
rulesrf_13 = RuledSurface(CurveA=item.Item11, CurveB=item.Item12)
rulesrf_14 = RuledSurface(CurveA=item.Item12, CurveB=item.Item13)
rulesrf_15 = RuledSurface(CurveA=item.Item14, CurveB=item.Item15)
rulesrf_16 = RuledSurface(CurveA=item.Item16, CurveB=item.Item17)
rulesrf_17 = RuledSurface(CurveA=item.Item15, CurveB=item.Item16)
rulesrf_18 = RuledSurface(CurveA=item.Item17, CurveB=item.Item18)
bang = ExplodeTree(Data=nickname.Maplist)  # -> Branch0, Branch1, Branch2, Branch3, Branch4, Branch5, Branch6, Branch7, Branch8, Branch9
geo = Geometry(nickname.Kappa)
crv = Curve(nickname.Curves)
crv_2 = Curve(nickname.DomainPolygon)
rulesrf_19 = RuledSurface(CurveA=item.Item19, CurveB=item.Item20)
rulesrf_20 = RuledSurface(CurveA=item.Item18, CurveB=item.Item19)
knob = ControlKnob(Decimals=0, Limit=True, Maximum=300, Minimum=0, Range=100, Value=107)
harmonic = Harmonic(Input=flatten(bang.Branch2))  # -> Pts, Values
pt_3 = Point(harmonic.Pts)
item_2 = ListItem(List=crv, Index=Slider(10, range=0..10), Wrap=True)
srfgrid = SurfaceFromPoints(Points=nickname.Kato_pointlist, UCount=Slider(20, range=0..200), Interpolate=False)
item_3 = ListItem(List=pt_3, Index=knob, Wrap=True)
end = EndPoints(Curve=item_2)  # -> Start, End
rgb = ColourRGB(Alpha=255, Red=harmonic.Values, Green=harmonic.Values, Blue=harmonic.Values)
preview = CustomPreview(
    Geometry=srfgrid,
    Material={diffuse=RGB(221, 160, 221), emission=RGB(66, 48, 66), shine=0.5, specular=RGB(255, 255, 255), transparency=0})
pt_4 = Point(end.Start)
dots = DotDisplay(Point=harmonic.Pts, Colour=rgb, Size=Slider(0.25, range=0..1))
panel = Panel(harmonic.Pts)
panel_3 = Panel()
pt_5 = Point(Point(1.190148824, 1.408117145, 0))
panel_4 = Panel(pt_5)
partition = PartitionList(List=panel_3, Size=Slider(6, range=0..10))
bang_2 = ExplodeTree(Data=partition)  # -> Branch0, Branch1, Branch2, Branch3
item_4 = ListItem(List=panel_4, Index=0, Wrap=True)
ma = MassAddition(Input=bang_2.Branch3)  # -> Result, PartialResults
panel_5 = Panel(ma.Result)
panel_6 = Panel(bang_2.Branch0)
panel_7 = Panel(item_4)
end_2 = EndPoints(Curve=crv_2)  # -> Start, End
item_5 = ListItem(Index=0, Wrap=True)
multiplication = Multiplication(A=end_2.Start, B=panel_6)
ma_2 = MassAddition(Input=multiplication)  # -> Result, PartialResults
panel_8 = Panel(ma_2.Result)
pt_6 = Point(ma_2.Result)
